# Grasshopper definition W12_buenos-aires-react.gh (Grasshopper 1.0.7)
# plug-ins: ClimateStudioGH, Firefly.X, treesloth01

trigger = Trigger(Interval=200, TimerInterval=200, Target=osc_listener)  # disabled
osc_listener = OSCListener(Port="3333", Reset=False)
panel = Panel("""/computeEui
/building""")
divide_branches = DivideBranches(DataTree=osc_listener, DivisionPattern=[0, 1], RenumberPaths=invert(False))  # -> Data0, Data1
item = ListItem(List=divide_branches.Data0, Index=0, Wrap=True)  # -> Item, Item1
item_2 = ListItem(List=divide_branches.Data1, Index=0, Wrap=True)  # -> Item, Item1
addr = Text(item.Item)
data = Text(item.Item1)
addr_2 = Text(item_2.Item)
# (2) Play the Game
data_2 = Text(item_2.Item1)
mindex = MemberIndex(Set=panel, Member=addr)  # -> Index, Count
mindex_2 = MemberIndex(Set=panel, Member=addr_2)  # -> Index, Count
gate = StreamGate(Stream=data, Gate=mindex.Index)  # -> Target0, Target1, Target2
gate_2 = StreamGate(Stream=data_2, Gate=mindex_2.Index)  # -> Target0, Target1, Target2

# ----
# (1) Game Preparation
# 1.1Search for Buenos Aires, and choose
# the Intl.AP version of the TMYx file!
# 1.2 Set Results Directory (leave as is if possible)
simulation_name = Panel("C:\temp\SimulationGame-react\")
weathersearch = SearchForWeather(
    Selection="C:\Users\Sam Wolk\AppData\Roaming\Solemma\ClimateStudio\WeatherFiles\ARG_BA_Buenos.Aires-Newbery.Intl.AP.875820_TMYx.2004-2018.epw",
    UnitSystem=4)

cluster = Cluster(data=gate_2.Target1)  # -> building_2, shading_depths_2, wwrs_2, tightness_3, tightness_4, floors_2, roofs_2, glazing_2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
equals = Equality(FirstNumber=gate.Target0, SecondNumber="1")  # -> Equality, Inequality
building = Geometry(cluster.building_2)
shading_depths = Number(cluster.shading_depths_2)
# 2.2 Set WWR and Shading Depth
#    * Shading cost: $0.15/m2
item_3 = ListItem(List=shading_depths, Index=0, Wrap=True)  # -> Item, Item1, Item2, Item3
wwrs = Number(cluster.wwrs_2)
multiplication = Multiplication(A=wwrs, B="100")
item_4 = ListItem(List=multiplication, Index=0, Wrap=True)  # -> Item, Item1, Item2, Item3
num = Number(cluster.tightness_3)
num_2 = Number(cluster.tightness_4)
num_3 = Number(cluster.floors_2)
num_4 = Number(cluster.roofs_2)
num_5 = Number(cluster.glazing_2)
shade_mounting_height = Slider(0, range=-1.5..1.5)
num_6 = Number(cluster.hrv_2)
num_7 = Number(cluster.source_hvac_2)
num_8 = Number(cluster.fans_2)
num_9 = Number(cluster.type_2)
num_10 = Number(cluster.dimming_2)
pipeline = GeometryPipeline(
    GroupByLayer=False,
    GroupByType=False,
    IncludeHidden=True,
    IncludeLocked=True,
    LayerFilter="ThermalZone",
    NameFilter="*",
    SublayerFiltering=True,
    TypeFilter=1073741848)
brep = Brep(building)
# 2.3 Set Energy Conservation Measures
# Windows
list = ValueList({"Baseline_U2.5_SHGC0.44_Tvis0.65 [$0.02/m2]": "Baseline_U2.5_SHGC0.44_Tvis0.65", "LowE_HighSolarGain_U1.3_SHGC0.65_Tvis0.50 [$0.04/m2]": "LowE_HighSolarGain_U1.3_SHGC0.65_Tvis0.50", "LowE_LowSolarGain_U1.3_SHGC0.22_Tvis0.37 [$0.04/m2]": "LowE_LowSolarGain_U1.3_SHGC0.22_Tvis0.37", "SuperLowE_ModerateSolarGain_U0.9_SHGC0.4_Tvis0.55 [$0.06/m2]": "SuperLowE_ModerateSolarGain_U0.9_SHGC0.4_Tvis0.55"}, selected="Baseline_U2.5_SHGC0.44_Tvis0.65 [$0.02/m2]")
# Opaque Building Envelope and Slabs
list_2 = ValueList({"Wall R2.5 [$0.02/m2]": "Wall R2.5", "Wall R5 [$0.07/m2]": "Wall R5", "Wall R7.5 [$0.1/m2]": "Wall R7.5"}, selected="Wall R2.5 [$0.02/m2]")
list_3 = ValueList({"Roof_R3 [$0.03/m2]": "Roof_R3", "Roof_R5 [$0.06/m2]": "Roof_R5", "Roof_R7 [$0.09/m2]": "Roof_R7", "Roof_R10 [$0.12/m2]": "Roof_R10"}, selected="Roof_R3 [$0.03/m2]")
list_4 = ValueList({"Wood Floors [$0.0/m2]": "Wood", "Concrete Floors [$0.02/m2]": "Concrete"}, selected="Wood Floors [$0.0/m2]")
# Lighting
list_5 = ValueList({"Baseline Flourescent 11 W/m2 [$0]": 11, "LED 6 W/m2 [$8]": 6}, selected="LED 6 W/m2 [$8]")
list_6 = ValueList({"No Dimming [$0]": "Off", "Daylight Dimming [$5]": "Continuous"}, selected="No Dimming [$0]")
# HVAC
list_7 = ValueList({"Electric Baseboard Heating, Direct Expansion Cooling [$0]": "1.0,3.1", "Gas-fired Boiler Heating, Direct Expansion Cooling [$6]": "0.90,3.1", "Ground Source Heat Pump Heating and Cooling [$12]": "3.1,3.93"}, selected="Gas-fired Boiler Heating, Direct Expansion Cooling [$6]")
list_8 = ValueList({"No Ceiling Fans [$0]": "Off", "Ceiling Fans, +1 C cooling setpoint [$5]": "On"}, selected="No Ceiling Fans [$0]")
list_9 = ValueList({"No HRV [$0]": "Off", "HRV (Sensible, 70% Efficient) [$3]": "On"}, selected="HRV (Sensible, 70% Efficient) [$3]")
list_10 = ValueList({"Basic Construction Tightness 0.4 ACH [$0]": 0.4, "Tight Envelope Construction 0.1 ACH [$6]": 0.1}, selected="Tight Envelope Construction 0.1 ACH [$6]")
panel_2 = Panel("SuperLowE_ModerateSolarGain_U0.9_SHGC0.4_Tvis0.55")
panel_3 = Panel(list)
timestamp = CSharpScript()  # -> out, A
# ---------- timestamp: C# ----------
    //DateTime.Now.ToString("yyyy-MM-dd-HH-mm-ss");
    A = DateTime.Now.ToString("HH-mm-ss");
# ---------- end timestamp ----------
time = Panel(timestamp.A)

# ----
# Model Settings / Details
# (Do not edit!)
# Parametric Shading (Cluster)
# Parametric Windows (Cluster)
# Context Geometry
retail_3a = GetZoneTemplate(Selection="Retail-3A")
brep_context = Brep([<brep referenced from the Rhino model> x5])
c_modify_zone_settings = CSharpScript(
    ZSetIn=retail_3a,
    WallConstruction=list_2,
    RoofConstruction=list_3,
    FloorSlabConstruction=list_4,
    LPD=list_5,
    DaylightDimming=list_6,
    HVAC=list_7,
    CeilingFans=list_8,
    HRV=list_9,
    ACH=list_10,
    Reference="C:\Program Files\Solemma\ClimateStudio\bin\ClimateStudioLib.dll")  # -> out, ZSetOut; inputs WallConstruction: String, RoofConstruction: String, FloorSlabConstruction: String, LPD: Double, DaylightDimming: String, HVAC: String, CeilingFans: String, HRV: String, ACH: Double
# ---------- c_modify_zone_settings: C# usings ----------
using CSEnergyLib.LibraryObjects;

using System.Linq;
# ---------- c_modify_zone_settings: C# ----------
    var settings = ZSetIn as CSZoneDefinition;

    // Lighting
    settings.Loads.LightingPowerDensity = LPD;
    settings.Loads.DimmingType = DaylightDimming == "Off" ? DimmingItem.Off : DimmingItem.Continuous;

    // Construction
    settings.Constructions.FacadeConstruction = WallConstruction;
    settings.Constructions.RoofConstruction = RoofConstruction;
    if (FloorSlabConstruction == "Wood") {
      settings.Constructions.SlabConstruction = "WoodFloor";
      settings.Constructions.GroundSlabConstruction = "WoodOnGrade";
      settings.Constructions.ExternalFloorConstruction = "WoodOnGrade";
    } else {
      settings.Constructions.SlabConstruction = "ConcreteFloor";
      settings.Constructions.GroundSlabConstruction = "ConcreteOnGrade";
      settings.Constructions.ExternalFloorConstruction = "ConcreteOnGrade";
    }


    // HVAC
    string[] HVACSettings = HVAC.Split(',');
    double heatingCOP = float.Parse(HVACSettings[0]);
    double coolingCOP = float.Parse(HVACSettings[1]);
    settings.Conditioning.HeatingCOP = heatingCOP;
    settings.Conditioning.CoolingCOP = coolingCOP;
    settings.Conditioning.HumidistatIsOn = true;
    settings.Conditioning.MinHumidity = 35.0;
    settings.Conditioning.MaxHumidity = 65.0;
    settings.Conditioning.HeatingSetpointConstant = false;
    settings.Conditioning.CoolingSetpointConstant = false;

    // infiltration
    settings.Infiltration.InfiltrationIsOn = true;
    settings.Infiltration.InfiltrationAch = ACH;

    // Ceiling fans
    settings.Conditioning.CoolingSetpointConstant = true;
    settings.Conditioning.CoolingSetpoint = 26.0;
    settings.Conditioning.HeatingSetpointConstant = true;
    settings.Conditioning.HeatingSetpoint = 22.0;
    if (CeilingFans == "On") {
      settings.Conditioning.CoolingSetpoint = 27.0;
    }

    // HRV
    if (HRV == "On") {
      settings.Conditioning.HeatRecoveryType = HeatRecoveryItem.Sensible;
      settings.Conditioning.HeatRecoveryEfficiencySensible = 0.70;
    } else {
      settings.Conditioning.HeatRecoveryType = HeatRecoveryItem.None;
    }

    // var coolingname = settings.Conditioning.CoolingSetpointSchedule;
    // var heatingname = settings.Conditioning.HeatingSetpointSchedule;
    // var coolingSched = CSLibraryInMemory.Instance.Library.YearSchedules365.FindLast(x => x.Name == coolingname);
    // double[] coolingVals = coolingSched.To8760Array();
    // double maxcool = coolingVals.Max();
    // double mincool = coolingVals.Min();
    // double[] newCoolingNV = new double[8760];




    ZSetOut = settings;
# ---------- end c_modify_zone_settings ----------
cluster_2 = Cluster_5(G=brep, scene=brep_context)
shading = Shading(Surface=flatten(cluster_2), Schedule="AllOff")
preview = CustomPreview(Geometry=brep_context, Material=ColourSwatch(SwatchColor=RGB(224, 224, 224)))
cluster_3 = Cluster_4(
    zone_geometry=brep,
    south_scale_input=item_4.Item1,
    north_scale_input=item_4.Item,
    east_scale_input=item_4.Item2,
    west_scale_input=item_4.Item3)  # -> wall_geometry_3, south_windows, north_windows, east_windows, west_windows, walls_south, walls_north, walls_east, walls_west
cluster_4 = Cluster_2(window_geometry=cluster_3.south_windows, shading_depth=item_3.Item1, height_of_shade=shade_mounting_height)
cluster_5 = Cluster_2(window_geometry=cluster_3.north_windows, shading_depth=item_3.Item, height_of_shade=shade_mounting_height)
cluster_6 = Cluster_2(window_geometry=cluster_3.east_windows, shading_depth=item_3.Item2, height_of_shade=shade_mounting_height)
cluster_7 = Cluster_2(window_geometry=cluster_3.west_windows, shading_depth=item_3.Item3, height_of_shade=shade_mounting_height)
cluster_8 = Cluster_3(windows=cluster_3.south_windows, walls=cluster_3.walls_south)
cluster_9 = Cluster_3(windows=cluster_3.north_windows, walls=cluster_3.walls_north)
cluster_10 = Cluster_3(windows=cluster_3.east_windows, walls=cluster_3.walls_east)
cluster_11 = Cluster_3(windows=cluster_3.west_windows, walls=cluster_3.walls_west)
cluster_12 = Cluster_3(
    windows=[cluster_3.south_windows, cluster_3.north_windows, cluster_3.east_windows, cluster_3.west_windows],
    walls=cluster_3.wall_geometry_3)
wset = WindowSettings(
    Name="SimulationGameGlass",
    GlazingConstruction=list,
    Input_0_Hidden=False,
    Input_0_Name="Name",
    Input_10_Hidden=True,
    Input_10_Name="ShadingThickness",
    Input_11_Hidden=True,
    Input_11_Name="ShadeGlassDistance",
    Input_12_Hidden=True,
    Input_12_Name="TopBottomEdgeOpeningMultiplier",
    Input_13_Hidden=True,
    Input_13_Name="Analysis Mesh Resolution",
    Input_14_Hidden=True,
    Input_14_Name="ZoneMixingIsOn",
    Input_15_Hidden=True,
    Input_15_Name="ZoneMixingDeltaTemperature",
    Input_16_Hidden=True,
    Input_16_Name="ZoneMixingFlowRate",
    Input_17_Hidden=False,
    Input_17_Name="Glazing Construction",
    Input_18_Hidden=True,
    Input_18_Name="OperableArea",
    Input_19_Hidden=True,
    Input_19_Name="ZoneMixingAvailibilitySchedule",
    Input_1_Hidden=False,
    Input_1_Name="WindowSettings",
    Input_20_Hidden=True,
    Input_20_Name="HasFrame",
    Input_21_Hidden=True,
    Input_21_Name="FrameWidth",
    Input_22_Hidden=True,
    Input_22_Name="FrameProjection"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)
zone = ThermalZone(
    Brep=brep,
    Name="SimulationGame",
    Settings=c_modify_zone_settings.ZSetOut,
    UsedLibraryObjects="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")  # -> Zones, Settings
roofs = Roofs()  # -> mat_6, mat_4, obj_3, mat, M_2, M, obj_4, mat_5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
walls = Walls()  # -> M_3, mat_3, obj_3, M_2, M, mat_2, obj_2, mat, obj
floors = Floors()  # -> con, mat_3, obj, con_2, mat, obj_2, mat_2
glazing = Glazing()  # -> obj, obj_2, obj_3, obj_4
data_3 = Data(flatten([roofs.mat_6, roofs.mat_4, roofs.obj_3, roofs.mat, roofs.M_2, roofs.M, roofs.obj_4, roofs.mat_5, roofs.obj_2, roofs.mat_3, roofs.obj, roofs.mat_2, walls.M_3, walls.mat_3, walls.obj_3, walls.M_2, walls.M, walls.mat_2, walls.obj_2, walls.mat, walls.obj, glazing.obj, glazing.obj_2, glazing.obj_3, glazing.obj_4, floors.con, floors.mat_3, floors.obj, floors.con_2, floors.mat, floors.obj_2, floors.mat_2]))
library = Library(AddObjects=data_3)

west_wwr = Panel(cluster_11)
west_windows = Slider(40, range=10..90)
shading_depth_m = Slider(0, range=0..2)

# ----
# Shade Mounting Height (M)
shading_depth_m_2 = Slider(0, range=0..2)
south_wwr = Panel(cluster_8)
south_windows = Slider(23, range=23..90)

north_wwr = Panel(cluster_9)
north_windows = Slider(83, range=10..90)
shading_depth_m_3 = Slider(0, range=0..2)

total_wwr = Panel(cluster_12)

east_windows = Slider(40, range=10..90)
east_wwr = Panel(cluster_10)
shading_depth_m_4 = Slider(0, range=0..2)

# ---- group: Automated Fixed Shades
shading_2 = Geometry(flatten([cluster_4, cluster_5, cluster_6, cluster_7]))

# ---- group: Automated Windows
windows = Brep([cluster_3.south_windows, cluster_3.north_windows, cluster_3.east_windows, cluster_3.west_windows])

# ----
null = NullItem(Item=shading_2)  # -> NullFlags, InvalidFlags, Description
cull = CullPattern(List=shading_2, CullPattern=invert(null.NullFlags))
shading_3 = Shading(Surface=cull, Schedule="AllOff")
window = Window(Surface=windows, Settings=wset, UsedLibraryObjects="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")  # -> Window, Settings

# ----
# 2.4 Give Descriptive Name | Check Cost | Run Simulation
#    * Enable / disable preview on Model component
model = ModelMaker(
    Zones=zone.Zones,
    Windows=window.Window,
    Shading=[shading_3, shading],
    Library=library,
    preview_displayAdia=True,
    preview_displayExtFloor=True,
    preview_displayFacades=True,
    preview_displayGround=True,
    preview_displayParts=True,
    preview_displayRoofs=True,
    preview_displayShade=True,
    preview_displaySlabs=True,
    preview_displayWins=True)

construction_cost = ConstructionCost(model=model, dimming=list_6, lpd=list_5, hvac=list_7, shade=cull, fans=list_8, hrv=list_9, ach=list_10)
floor_area = FloorArea(model=model)

# ----
# 2.1 Load Zone Geometry
#    * Model one Brep per floor!
# Floor area between 2400 - 2600 m2
floor_area_m2 = Panel(floor_area)

# ----
# Cost<= CS$50
total_construction_cost_cs = Panel(construction_cost)
simulation_name_2 = Panel("test")
run_simulation = Button()

merge = Merge(Data1=simulation_name_2, Data2=total_construction_cost_cs)
cost = Number(total_construction_cost_cs)
join = TextJoin(Text=merge, Join="_")
osc_sender = OSCSender(Data=cost, IPAddressOfUDPServer="127.0.0.1", UDPPort="3334")
run_e = RunCSEnergyModel(
    Model=model,
    Name=simulation_name_2,
    Directory=simulation_name,
    Location=weathersearch,
    Run=equals.Equality,
    settings="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")  # -> Model, Settings, Result
result_files = DataRecorder(run_e.Result, DataLimit=-10, RecordData=True)
energy_results = LoadCSRResultFile(ThermalModel=run_e.Model, Mode=0, Toggle=Toggle(True))  # -> TotalEUI, Baseline, TotalCO2, TotalCost, FloorArea, Data, Labels, Months, Colors, CSR
energy_results_2 = LoadCSRResultFile(ThermalModel=run_e.Model, Mode=2, Toggle=Toggle(True))  # -> TotalEUI, Baseline, TotalCO2, TotalCost, FloorArea, Data, Labels, Months, Colors, CSR
# (3) Game End
# 2.5 View EUI and Analyze Monthly Results
energy_result_comparison = CSEnergyResultComparison(
    R=result_files,
    DataType="EnergyUseIntensity",
    Target=0,
    Baseline=0,
    Directory=simulation_name,
    FileName="GameResults",
    PNGOrPDF="PDF",
    Width=800,
    Height=500,
    CreatePlot=False,
    PreviewDimension="Large",
    Input_0_Hidden=False,
    Input_0_Name="Result Files",
    Input_10_Hidden=False,
    Input_10_Name="File Name",
    Input_11_Hidden=False,
    Input_11_Name="PNG or PDF",
    Input_12_Hidden=False,
    Input_12_Name="Width",
    Input_13_Hidden=False,
    Input_13_Name="Height",
    Input_14_Hidden=True,
    Input_14_Name="Text Scaler",
    Input_15_Hidden=True,
    Input_15_Name="Lineweight Scaler",
    Input_16_Hidden=False,
    Input_16_Name="Create Plot",
    Input_17_Hidden=False,
    Input_17_Name="Preview Dimension",
    Input_18_Hidden=True,
    Input_18_Name="Infinate Zoom Display",
    Input_1_Hidden=True,
    Input_1_Name="Result Comparison File",
    Input_2_Hidden=False,
    Input_2_Name="Data Type",
    Input_3_Hidden=True,
    Input_3_Name="Bar Width",
    Input_4_Hidden=True,
    Input_4_Name="Show Numbers",
    Input_5_Hidden=True,
    Input_5_Name="Show Percent"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)
ma = MassAddition(Input=flatten(energy_results.Data))  # -> Result, PartialResults
eui = Number(ma.Result)
osc_sender_2 = OSCSender(Data=eui, IPAddressOfUDPServer="127.0.0.1", UDPPort="3334")
# Open EUI Comparion Component,
# Save Chart and Export Results as PDF
xyplot = XYPlot(
    Type=2,
    Width="500",
    Height="500",
    Title="Energy Use Intensity",
    Y_title="[kWh/m2/yr]",
    X_labels=energy_results.Months,
    X_rot=0,
    Y_data=energy_results.Data,
    Colors=energy_results.Colors,
    Names=energy_results.Labels,
    Range="0 To 20",
    Show_xgrid=False,
    Show_ygrid=True,
    Legend=0,
    PreviewDimension=1,
    InfinateZoomDisplay=True,
    UnitSystem=4)
xyplot_2 = XYPlot(
    Type=2,
    Width="1000",
    Height=450,
    Title="Loads",
    Y_title="[kWh]",
    X_labels=energy_results_2.Months,
    X_rot=0,
    Y_data=energy_results_2.Data,
    Colors=energy_results_2.Colors,
    Names=energy_results_2.Labels,
    Range="-50000 To 50000",
    Show_xgrid=False,
    Show_ygrid=True,
    Legend=0,
    PreviewDimension=1,
    InfinateZoomDisplay=True,
    UnitSystem=4)

# ==== cluster Cluster
data = ClusterInput()
data_2 = Text(data)
python = GhPythonScript(data=data_2, key="shading")  # -> out, value
# ---------- python: Python ----------
__author__ = "szvsw"
__version__ = "2022.01.03"

import rhinoscriptsyntax as rs
import json


data = data.replace("\x00","")

data = json.loads(data)

value = json.dumps(data[key])
# ---------- end python ----------
python_2 = GhPythonScript(data=data_2, key="wwr")  # -> out, value; same code as python
python_3 = GhPythonScript(data=data_2, key="mass")  # -> out, value; same code as python
python_4 = GhPythonScript(data=data_2, key="glazing")  # -> out, value; same code as python
python_5 = GhPythonScript(data=data_2, key="envelope")  # -> out, value; same code as python
python_6 = GhPythonScript(data=data_2, key="hvac")  # -> out, value; same code as python
python_7 = GhPythonScript(data=data_2, key="lighting")  # -> out, value; same code as python
panel = Panel("""n
s
e
w""")
python_8 = GhPythonScript(data=python.value, key=panel)  # -> out, value; same code as python
python_9 = GhPythonScript(data=python_3.value, key="width")  # -> out, value; same code as python
python_10 = GhPythonScript(data=python_3.value, key="depth")  # -> out, value; same code as python
python_11 = GhPythonScript(data=python_2.value, key=panel)  # -> out, value; same code as python
python_12 = GhPythonScript(data=python_3.value, key="floors")  # -> out, value; same code as python
python_13 = GhPythonScript(data=python_3.value, key="floorHeight")  # -> out, value; same code as python
python_14 = GhPythonScript(data=python_5.value, key="roofs")  # -> out, value; same code as python
python_15 = GhPythonScript(data=python_5.value, key="tightness")  # -> out, value; same code as python
python_16 = GhPythonScript(data=python_5.value, key="walls")  # -> out, value; same code as python
python_17 = GhPythonScript(data=python_4.value, key="assembly")  # -> out, value; same code as python
python_18 = GhPythonScript(data=python_5.value, key="floors")  # -> out, value; same code as python
shading_depths = Number(python_8.value)
wwrs = Number(python_11.value)
python_19 = GhPythonScript(data=python_6.value, key="hrv")  # -> out, value; same code as python
python_20 = GhPythonScript(data=python_6.value, key="source")  # -> out, value; same code as python
python_21 = GhPythonScript(data=python_7.value, key="dimming")  # -> out, value; same code as python
python_22 = GhPythonScript(data=python_7.value, key="type")  # -> out, value; same code as python
python_23 = GhPythonScript(data=python_6.value, key="fans")  # -> out, value; same code as python
tightness = Data(python_16.value)
roofs = Data(python_14.value)
tightness_2 = Data(python_15.value)
glazing = Data(python_17.value)
floors = Data(python_18.value)
shading_depths_2 = ClusterOutput(shading_depths)
wwrs_2 = ClusterOutput(wwrs)
series = Series(Start=0, Step=1, Count=python_12.value)
tightness_3 = ClusterOutput(tightness_2)
hrv = Number(python_19.value)
source_hvac = Number(python_20.value)
fans = Number(python_23.value)
tightness_4 = ClusterOutput(tightness)
floors_2 = ClusterOutput(floors)
dimming = Number(python_21.value)
type = Number(python_22.value)
glazing_2 = ClusterOutput(glazing)
roofs_2 = ClusterOutput(roofs)
box = DomainBox(Base=PlaneXY(0, 0, 0), X=python_9.value, Y=python_10.value, Z=python_13.value)
hrv_2 = ClusterOutput(hrv)
source_hvac_2 = ClusterOutput(source_hvac)
dimming_2 = ClusterOutput(dimming)
fans_2 = ClusterOutput(fans)
type_2 = ClusterOutput(type)
multiplication = Multiplication(A=python_13.value, B=series)
Z = UnitZ(Factor=multiplication)
move = Move(Geometry=box, Motion=Z)  # -> Geometry, Transform
building = Geometry(move.Geometry)
building_2 = ClusterOutput(building)

# ==== cluster Cluster_2
window_geometry = ClusterInput()
shading_depth = ClusterInput()

# ---- group: Generate Box Frame Around Windows
debrep = DeconstructBrep(WindowGeometry=window_geometry)  # -> Faces, Edges, Vertices
pcen = PolygonCenter(Polyline=debrep.Edges)  # -> CenterV, CenterE, CenterA
evalsrf = EvaluateSurface(Surface=debrep.Faces, Point=pcen.CenterV)  # -> Point, Normal, Frame
multiplication = Multiplication(A=evalsrf.Normal, ShadingDepth=shading_depth)
extr = Extrude(Base=debrep.Edges, Direction=multiplication)

# ----
debrep_2 = DeconstructBrep(ShadingBoxFrame=extr)  # -> Faces, Edges, Vertices

# ---- group: list item for reference
flatten = FlattenTree(Tree=debrep_2.Faces, Path="{0}")
item = ListItem(List=flatten, Index=Slider(2, range=0..20), Wrap=True)

# ----
area = Area(Geometry=debrep_2.Faces)  # -> Area, Centroid

# ---- group: Get Normals with respect to window center point
evalsrf_2 = EvaluateSurface(Surface=debrep_2.Faces, Point=area.Centroid)  # -> Point, Normal, Frame

# ----
Z = UnitZ(Factor=1)
panel = Panel(evalsrf_2.Normal)

# ---- group: Dot Product of Vectors (isolate Z vector, range from -1 to 1 for how the original matches the second vector)
dprod = DotProduct(VectorA=evalsrf_2.Normal, VectorB=Z, Unitize=False)

# ---- group: Pull out only negative values
smaller = SmallerThan(FirstNumber=dprod, SecondNumber="0")  # -> SmallerThan, OrEqualTo

# ----
panel_2 = Panel(dprod)
panel_3 = Panel(smaller.SmallerThan)
dispatch = Dispatch(List=debrep_2.Faces, DispatchPattern=smaller.SmallerThan)  # -> AutomatedShading, ListB
height_of_shade = ClusterInput()
Z_2 = UnitZ(HeightOfShade=height_of_shade)
area_2 = Area(Geometry=dispatch.AutomatedShading)  # -> Area, Centroid
scale = Scale(Geometry=dispatch.AutomatedShading, Center=area_2.Centroid, Factor=Slider(1, range=0..1))  # -> Geometry, Transform
move = Move(Geometry=scale.Geometry, Motion=Z_2)  # -> AutomatedShading, Transform
automated_shading = ClusterOutput(move.AutomatedShading)

# ==== cluster Cluster_3
walls = ClusterInput()
windows = ClusterInput()

# ---- group: Get Wall Area
area = Area(Geometry=walls)  # -> flatten(Area), Centroid
ma = MassAddition(Input=area.Area)  # -> Result, PartialResults
tot_wall_area = Panel(ma.Result)

# ---- group: Get Window Area
area_2 = Area(Geometry=windows)  # -> flatten(Area), Centroid
ma_2 = MassAddition(Input=area_2.Area)  # -> Result, PartialResults
tot_window_area = Panel(ma_2.Result)

# ----
division = Division(A=ma_2.Result, B=ma.Result)
multiplication = Multiplication(A=division, B="100")
round = Round(Number=multiplication)  # -> Nearest, Floor, Ceiling
join = TextJoin(Text=[round.Nearest, "%"])
panel = Panel(join)
R = ClusterOutput(join)

# ==== cluster Cluster_4
zone_geometry = ClusterInput()

# ---- group: Select only Walls
debrep = DeconstructBrep(ZoneGeometry=zone_geometry)  # -> Faces, Edges, Vertices
area = Area(Geometry=debrep.Faces)  # -> Area, Centroid
evalsrf = EvaluateSurface(Surface=debrep.Faces, Point=area.Centroid)  # -> Point, Normal, Frame
Z = UnitZ(Factor=1)
dprod = DotProduct(VectorA=evalsrf.Normal, VectorB=Z, Unitize=False)
abs = Absolute(Value=dprod)
smaller = SmallerThan(FirstNumber=abs, SecondNumber=".9")  # -> SmallerThan, OrEqualTo
panel = Panel(abs)
dispatch = Dispatch(List=debrep.Faces, DispatchPattern=smaller.SmallerThan)  # -> ListA, ListB
wall_geometry = Geometry(dispatch.ListA)

# ----
# SOUTH
area_2 = Area(Geometry=wall_geometry)  # -> Area, Centroid
evalsrf_2 = EvaluateSurface(Surface=wall_geometry, Point=area_2.Centroid)  # -> Point, Normal, Frame
Y = UnitY(Factor=1)
dprod_2 = DotProduct(VectorA=evalsrf_2.Normal, VectorB=Y, Unitize=False)
smaller_2 = SmallerThan(FirstNumber=dprod_2, SecondNumber="-.71")  # -> SmallerThan, OrEqualTo
dispatch_2 = Dispatch(List=dispatch.ListA, DispatchPattern=smaller_2.SmallerThan)  # -> WallsSouth, ListB
wall_geometry_2 = Geometry(dispatch_2.WallsSouth)

wall_geometry_3 = ClusterOutput(wall_geometry)
panel_2 = Panel(dprod_2)
south_scale_input = ClusterInput()
west_scale_input = ClusterInput()
north_scale_input = ClusterInput()
east_scale_input = ClusterInput()

# ---- group: User-Defined WWR Scale
division = Division(WestScaleInput=west_scale_input, B="100")

division_2 = Division(NorthScaleInput=north_scale_input, B="100")

division_3 = Division(EastScaleInput=east_scale_input, B="100")

# ---- group: Centroids of Walls
area_3 = Area(Geometry=dispatch_2.WallsSouth)  # -> Area, Centroid

# ---- group: User-Defined WWR Scale
division_4 = Division(SouthScaleInput=south_scale_input, B="100")

# ----
sqrt = SquareRoot(Value=division_4)

# ---- group: WINDOW GEOMETRIES
scale = Scale(Geometry=dispatch_2.WallsSouth, Center=area_3.Centroid, Factor=sqrt)  # -> flatten(SouthWindows), Transform

# ----
sqrt_2 = SquareRoot(Value=division_3)
sqrt_3 = SquareRoot(Value=division)
sqrt_4 = SquareRoot(Value=division_2)
south_windows = ClusterOutput(scale.SouthWindows)
walls_south = ClusterOutput(dispatch_2.WallsSouth)

# ----
# WEST
area_4 = Area(Geometry=wall_geometry)  # -> Area, Centroid
X = UnitX(Factor=1)
evalsrf_3 = EvaluateSurface(Surface=wall_geometry, Point=area_4.Centroid)  # -> Point, Normal, Frame
dprod_3 = DotProduct(VectorA=evalsrf_3.Normal, VectorB=X, Unitize=False)

smaller_3 = SmallerThan(FirstNumber=dprod_3, SecondNumber="-.7")  # -> SmallerThan, OrEqualTo

dispatch_3 = Dispatch(List=dispatch.ListA, DispatchPattern=smaller_3.SmallerThan)  # -> WallsWEST, ListB
wall_geometry_4 = Geometry(dispatch_3.WallsWEST)

# ---- group: Centroids of Walls
area_5 = Area(Geometry=dispatch_3.WallsWEST)  # -> Area, Centroid

# ---- group: WINDOW GEOMETRIES
scale_2 = Scale(Geometry=dispatch_3.WallsWEST, Center=area_5.Centroid, Factor=sqrt_3)  # -> flatten(WESTWindows), Transform

# ----
west_windows = ClusterOutput(scale_2.WESTWindows)
walls_west = ClusterOutput(dispatch_3.WallsWEST)

# ----
# NORTH
area_6 = Area(Geometry=wall_geometry)  # -> Area, Centroid
Y_2 = UnitY(Factor=1)
evalsrf_4 = EvaluateSurface(Surface=wall_geometry, Point=area_6.Centroid)  # -> Point, Normal, Frame
dprod_4 = DotProduct(VectorA=evalsrf_4.Normal, VectorB=Y_2, Unitize=False)

larger = LargerThan(FirstNumber=dprod_4, SecondNumber=".71")  # -> LargerThan, OrEqualTo

dispatch_4 = Dispatch(List=dispatch.ListA, DispatchPattern=larger.LargerThan)  # -> WallsNORTH, ListB
wall_geometry_5 = Geometry(dispatch_4.WallsNORTH)

# ---- group: Centroids of Walls
area_7 = Area(Geometry=dispatch_4.WallsNORTH)  # -> Area, Centroid

# ---- group: WINDOW GEOMETRIES
scale_3 = Scale(Geometry=dispatch_4.WallsNORTH, Center=area_7.Centroid, Factor=sqrt_4)  # -> flatten(NORTHWindows), Transform

# ----
north_windows = ClusterOutput(scale_3.NORTHWindows)
walls_north = ClusterOutput(dispatch_4.WallsNORTH)

# ----
# EAST
area_8 = Area(Geometry=wall_geometry)  # -> Area, Centroid
X_2 = UnitX(Factor=1)
evalsrf_5 = EvaluateSurface(Surface=wall_geometry, Point=area_8.Centroid)  # -> Point, Normal, Frame
dprod_5 = DotProduct(VectorA=evalsrf_5.Normal, VectorB=X_2, Unitize=False)

larger_2 = LargerThan(FirstNumber=dprod_5, SecondNumber=".7")  # -> LargerThan, OrEqualTo

dispatch_5 = Dispatch(List=dispatch.ListA, DispatchPattern=larger_2.LargerThan)  # -> WallsEAST, ListB
wall_geometry_6 = Geometry(dispatch_5.WallsEAST)

# ---- group: Centroids of Walls
area_9 = Area(Geometry=dispatch_5.WallsEAST)  # -> Area, Centroid

# ---- group: WINDOW GEOMETRIES
scale_4 = Scale(Geometry=dispatch_5.WallsEAST, Center=area_9.Centroid, Factor=sqrt_2)  # -> flatten(EASTWindows), Transform

# ----
east_windows = ClusterOutput(scale_4.EASTWindows)
walls_east = ClusterOutput(dispatch_5.WallsEAST)

# ==== cluster Roofs

density = Panel("35")
material_name = Panel("XPS Insulation_R10")
conductivity = Panel(".034")
specific_heat_capacity = Panel("1400")

material_name_2 = Panel("XPS Insulation_R7")
conductivity_2 = Panel(".034")
density_2 = Panel("35")
specific_heat_capacity_2 = Panel("1400")

density_3 = Panel("35")
material_name_3 = Panel("XPS Insulation_R3")
conductivity_3 = Panel(".034")
specific_heat_capacity_3 = Panel("1400")
thickness = Panel(".09")

conductivity_4 = Panel(".7")
density_4 = Panel("2100")
# Roof Constructions
material_name_4 = Panel("Asphalt")
specific_heat_capacity_4 = Panel("1000")
conductivity_5 = Panel(".06")
density_5 = Panel("300")
material_name_5 = Panel("Fiberboard")
specific_heat_capacity_5 = Panel("1000")

density_6 = Panel("35")
material_name_6 = Panel("XPS Insulation_R5")
conductivity_6 = Panel(".034")
specific_heat_capacity_6 = Panel("1400")

material = OpaqueMaterial(
    Name=material_name,
    Conductivity=conductivity,
    Density=density,
    Roughness="Rough",
    SpecificHeat=specific_heat_capacity,
    ThermalAbsorptance=0.9,
    SolarAbsorptance=0.7,
    VisibleAbsorptance=0.7,
    Type="Insulation",
    Input_0_Hidden=False,
    Input_0_Name="Name",
    Input_10_Hidden=True,
    Input_10_Name="TemperatureCoefficientThermalConductivity",
    Input_11_Hidden=True,
    Input_11_Name="TemperatureArray",
    Input_12_Hidden=True,
    Input_12_Name="EnthalpyArray",
    Input_13_Hidden=True,
    Input_13_Name="VariableConductivityArray",
    Input_14_Hidden=False,
    Input_14_Name="Type",
    Input_15_Hidden=True,
    Input_15_Name="EmbodiedEnergy",
    Input_16_Hidden=True,
    Input_16_Name="EmbodiedCarbon",
    Input_17_Hidden=True,
    Input_17_Name="Cost",
    Input_18_Hidden=True,
    Input_18_Name="Life",
    Input_1_Hidden=False,
    Input_1_Name="Conductivity",
    Input_2_Hidden=False,
    Input_2_Name="Density",
    Input_3_Hidden=False,
    Input_3_Name="Roughness",
    Input_4_Hidden=False,
    Input_4_Name="SpecificHeat",
    Input_5_Hidden=False,
    Input_5_Name="ThermalAbsorptance"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)
material_2 = OpaqueMaterial(
    Name=material_name_2,
    Conductivity=conductivity_2,
    Density=density_2,
    Roughness="Rough",
    SpecificHeat=specific_heat_capacity_2,
    ThermalAbsorptance=0.9,
    SolarAbsorptance=0.7,
    VisibleAbsorptance=0.7,
    Type="Insulation",
    Input_0_Hidden=False,
    Input_0_Name="Name",
    Input_10_Hidden=True,
    Input_10_Name="TemperatureCoefficientThermalConductivity",
    Input_11_Hidden=True,
    Input_11_Name="TemperatureArray",
    Input_12_Hidden=True,
    Input_12_Name="EnthalpyArray",
    Input_13_Hidden=True,
    Input_13_Name="VariableConductivityArray",
    Input_14_Hidden=False,
    Input_14_Name="Type",
    Input_15_Hidden=True,
    Input_15_Name="EmbodiedEnergy",
    Input_16_Hidden=True,
    Input_16_Name="EmbodiedCarbon",
    Input_17_Hidden=True,
    Input_17_Name="Cost",
    Input_18_Hidden=True,
    Input_18_Name="Life",
    Input_1_Hidden=False,
    Input_1_Name="Conductivity",
    Input_2_Hidden=False,
    Input_2_Name="Density",
    Input_3_Hidden=False,
    Input_3_Name="Roughness",
    Input_4_Hidden=False,
    Input_4_Name="SpecificHeat",
    Input_5_Hidden=False,
    Input_5_Name="ThermalAbsorptance"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)
material_3 = OpaqueMaterial(
    Name=material_name_3,
    Conductivity=conductivity_3,
    Density=density_3,
    Roughness="Rough",
    SpecificHeat=specific_heat_capacity_3,
    ThermalAbsorptance=0.9,
    SolarAbsorptance=0.7,
    VisibleAbsorptance=0.7,
    Type="Insulation",
    Input_0_Hidden=False,
    Input_0_Name="Name",
    Input_10_Hidden=True,
    Input_10_Name="TemperatureCoefficientThermalConductivity",
    Input_11_Hidden=True,
    Input_11_Name="TemperatureArray",
    Input_12_Hidden=True,
    Input_12_Name="EnthalpyArray",
    Input_13_Hidden=True,
    Input_13_Name="VariableConductivityArray",
    Input_14_Hidden=False,
    Input_14_Name="Type",
    Input_15_Hidden=True,
    Input_15_Name="EmbodiedEnergy",
    Input_16_Hidden=True,
    Input_16_Name="EmbodiedCarbon",
    Input_17_Hidden=True,
    Input_17_Name="Cost",
    Input_18_Hidden=True,
    Input_18_Name="Life",
    Input_1_Hidden=False,
    Input_1_Name="Conductivity",
    Input_2_Hidden=False,
    Input_2_Name="Density",
    Input_3_Hidden=False,
    Input_3_Name="Roughness",
    Input_4_Hidden=False,
    Input_4_Name="SpecificHeat",
    Input_5_Hidden=False,
    Input_5_Name="ThermalAbsorptance"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)
material_4 = OpaqueMaterial(
    Name=material_name_5,
    Conductivity=conductivity_5,
    Density=density_5,
    Roughness="Rough",
    SpecificHeat=specific_heat_capacity_5,
    ThermalAbsorptance=0.9,
    SolarAbsorptance=0.7,
    VisibleAbsorptance=0.7,
    Type="Boards",
    Input_0_Hidden=False,
    Input_0_Name="Name",
    Input_10_Hidden=True,
    Input_10_Name="TemperatureCoefficientThermalConductivity",
    Input_11_Hidden=True,
    Input_11_Name="TemperatureArray",
    Input_12_Hidden=True,
    Input_12_Name="EnthalpyArray",
    Input_13_Hidden=True,
    Input_13_Name="VariableConductivityArray",
    Input_14_Hidden=False,
    Input_14_Name="Type",
    Input_15_Hidden=True,
    Input_15_Name="EmbodiedEnergy",
    Input_16_Hidden=True,
    Input_16_Name="EmbodiedCarbon",
    Input_17_Hidden=True,
    Input_17_Name="Cost",
    Input_18_Hidden=True,
    Input_18_Name="Life",
    Input_1_Hidden=False,
    Input_1_Name="Conductivity",
    Input_2_Hidden=False,
    Input_2_Name="Density",
    Input_3_Hidden=False,
    Input_3_Name="Roughness",
    Input_4_Hidden=False,
    Input_4_Name="SpecificHeat",
    Input_5_Hidden=False,
    Input_5_Name="ThermalAbsorptance"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)
material_5 = OpaqueMaterial(
    Name=material_name_4,
    Conductivity=conductivity_4,
    Density=density_4,
    Roughness="Rough",
    SpecificHeat=specific_heat_capacity_4,
    ThermalAbsorptance=0.9,
    SolarAbsorptance=0.7,
    VisibleAbsorptance=0.7,
    Type="Finishes",
    Input_0_Hidden=False,
    Input_0_Name="Name",
    Input_10_Hidden=True,
    Input_10_Name="TemperatureCoefficientThermalConductivity",
    Input_11_Hidden=True,
    Input_11_Name="TemperatureArray",
    Input_12_Hidden=True,
    Input_12_Name="EnthalpyArray",
    Input_13_Hidden=True,
    Input_13_Name="VariableConductivityArray",
    Input_14_Hidden=False,
    Input_14_Name="Type",
    Input_15_Hidden=True,
    Input_15_Name="EmbodiedEnergy",
    Input_16_Hidden=True,
    Input_16_Name="EmbodiedCarbon",
    Input_17_Hidden=True,
    Input_17_Name="Cost",
    Input_18_Hidden=True,
    Input_18_Name="Life",
    Input_1_Hidden=False,
    Input_1_Name="Conductivity",
    Input_2_Hidden=False,
    Input_2_Name="Density",
    Input_3_Hidden=False,
    Input_3_Name="Roughness",
    Input_4_Hidden=False,
    Input_4_Name="SpecificHeat",
    Input_5_Hidden=False,
    Input_5_Name="ThermalAbsorptance"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)
material_6 = OpaqueMaterial(
    Name=material_name_6,
    Conductivity=conductivity_6,
    Density=density_6,
    Roughness="Rough",
    SpecificHeat=specific_heat_capacity_6,
    ThermalAbsorptance=0.9,
    SolarAbsorptance=0.7,
    VisibleAbsorptance=0.7,
    Type="Insulation",
    Input_0_Hidden=False,
    Input_0_Name="Name",
    Input_10_Hidden=True,
    Input_10_Name="TemperatureCoefficientThermalConductivity",
    Input_11_Hidden=True,
    Input_11_Name="TemperatureArray",
    Input_12_Hidden=True,
    Input_12_Name="EnthalpyArray",
    Input_13_Hidden=True,
    Input_13_Name="VariableConductivityArray",
    Input_14_Hidden=False,
    Input_14_Name="Type",
    Input_15_Hidden=True,
    Input_15_Name="EmbodiedEnergy",
    Input_16_Hidden=True,
    Input_16_Name="EmbodiedCarbon",
    Input_17_Hidden=True,
    Input_17_Name="Cost",
    Input_18_Hidden=True,
    Input_18_Name="Life",
    Input_1_Hidden=False,
    Input_1_Name="Conductivity",
    Input_2_Hidden=False,
    Input_2_Name="Density",
    Input_3_Hidden=False,
    Input_3_Name="Roughness",
    Input_4_Hidden=False,
    Input_4_Name="SpecificHeat",
    Input_5_Hidden=False,
    Input_5_Name="ThermalAbsorptance"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)
material_7 = GetMaterial(Selection="Gypsum Or Plaster Board")
material_8 = GetMaterial(Selection="Concrete")
thickness_2 = Panel(".344")
thickness_3 = Panel(".019")
mat = ClusterOutput(material_3)
thickness_4 = Panel(".23")
mat_2 = ClusterOutput(material)
mat_3 = ClusterOutput(material_2)
thickness_5 = Panel(".013")
thickness_6 = Panel(".013")
thickness_7 = Panel(".152")
mat_4 = ClusterOutput(material_4)
mat_5 = ClusterOutput(material_6)
thickness_8 = Panel(".1")
layer = Layer(Material=material, Thickness=thickness_2)
layer_2 = Layer(Material=material_2, Thickness=thickness_4)
layer_3 = Layer(Material=material_3, Thickness=thickness)
layer_4 = Layer(Material=material_5, Thickness=thickness_3)
layer_5 = Layer(Material=material_4, Thickness=thickness_6)
layer_6 = Layer(Material=material_6, Thickness=thickness_7)
M = ClusterOutput(material_7)
layer_7 = Layer(Material=material_7, Thickness=thickness_5)
M_2 = ClusterOutput(material_8)
mat_6 = ClusterOutput(material_5)
layer_8 = Layer(Material=material_8, Thickness=thickness_8)
layer_order = Merge(Data1=layer_4, Data2=layer_5, Data3=layer, Data4=layer_8, Data5=layer_7)
layer_order_2 = Merge(Data1=layer_4, Data2=layer_5, Data3=layer_2, Data4=layer_8, Data5=layer_7)
layer_order_3 = Merge(Data1=layer_4, Data2=layer_5, Data3=layer_3, Data4=layer_8, Data5=layer_7)
construction_name = Panel("Roof_R10")
construction_name_2 = Panel("Roof_R7")
layer_order_4 = Merge(Data1=layer_4, Data2=layer_5, Data3=layer_6, Data4=layer_8, Data5=layer_7)  # -> flatten(Result)
construction_name_3 = Panel("Roof_R3")
construction_name_4 = Panel("Roof_R5")
construction = Construction(
    Name=construction_name_2,
    Category="Roof",
    Layers=flatten(layer_order_2),
    Input_0_Hidden=False,
    Input_0_Name="Name",
    Input_1_Hidden=False,
    Input_1_Name="Category",
    Input_2_Hidden=False,
    Input_2_Name="Layers",
    Input_3_Hidden=True,
    Input_3_Name="EmbodiedEnergy",
    Input_4_Hidden=True,
    Input_4_Name="EmbodiedCarbon",
    Input_5_Hidden=True,
    Input_5_Name="Cost",
    Input_6_Hidden=True,
    Input_6_Name="Life",
    UnitSystem=4,
    Input_3_GHParam_Branch0_Path="{0}",
    Input_3_GHParam_Branch0_Item0_number=0,
    Input_4_GHParam_Branch0_Path="{0}",
    Input_4_GHParam_Branch0_Item0_number=0,
    Input_5_GHParam_Branch0_Path="{0}",
    Input_5_GHParam_Branch0_Item0_number=0,
    Input_6_GHParam_Branch0_Path="{0}",
    Input_6_GHParam_Branch0_Item0_number=10)  # -> Construction, ConstructionInformation
construction_2 = Construction(
    Name=construction_name,
    Category="Roof",
    Layers=flatten(layer_order),
    Input_0_Hidden=False,
    Input_0_Name="Name",
    Input_1_Hidden=False,
    Input_1_Name="Category",
    Input_2_Hidden=False,
    Input_2_Name="Layers",
    Input_3_Hidden=True,
    Input_3_Name="EmbodiedEnergy",
    Input_4_Hidden=True,
    Input_4_Name="EmbodiedCarbon",
    Input_5_Hidden=True,
    Input_5_Name="Cost",
    Input_6_Hidden=True,
    Input_6_Name="Life",
    UnitSystem=4,
    Input_3_GHParam_Branch0_Path="{0}",
    Input_3_GHParam_Branch0_Item0_number=0,
    Input_4_GHParam_Branch0_Path="{0}",
    Input_4_GHParam_Branch0_Item0_number=0,
    Input_5_GHParam_Branch0_Path="{0}",
    Input_5_GHParam_Branch0_Item0_number=0,
    Input_6_GHParam_Branch0_Path="{0}",
    Input_6_GHParam_Branch0_Item0_number=10)  # -> Construction, ConstructionInformation
cost_m2 = Panel(".055")
construction_3 = Construction(
    Name=construction_name_3,
    Category="Roof",
    Layers=flatten(layer_order_3),
    Input_0_Hidden=False,
    Input_0_Name="Name",
    Input_1_Hidden=False,
    Input_1_Name="Category",
    Input_2_Hidden=False,
    Input_2_Name="Layers",
    Input_3_Hidden=True,
    Input_3_Name="EmbodiedEnergy",
    Input_4_Hidden=True,
    Input_4_Name="EmbodiedCarbon",
    Input_5_Hidden=True,
    Input_5_Name="Cost",
    Input_6_Hidden=True,
    Input_6_Name="Life",
    UnitSystem=4,
    Input_3_GHParam_Branch0_Path="{0}",
    Input_3_GHParam_Branch0_Item0_number=0,
    Input_4_GHParam_Branch0_Path="{0}",
    Input_4_GHParam_Branch0_Item0_number=0,
    Input_5_GHParam_Branch0_Path="{0}",
    Input_5_GHParam_Branch0_Item0_number=0,
    Input_6_GHParam_Branch0_Path="{0}",
    Input_6_GHParam_Branch0_Item0_number=10)  # -> Construction, ConstructionInformation
cost_m2_2 = Panel(".01")
construction_4 = Construction(
    Name=construction_name_4,
    Category="Roof",
    Layers=flatten(layer_order_4),
    Input_0_Hidden=False,
    Input_0_Name="Name",
    Input_1_Hidden=False,
    Input_1_Name="Category",
    Input_2_Hidden=False,
    Input_2_Name="Layers",
    Input_3_Hidden=True,
    Input_3_Name="EmbodiedEnergy",
    Input_4_Hidden=True,
    Input_4_Name="EmbodiedCarbon",
    Input_5_Hidden=True,
    Input_5_Name="Cost",
    Input_6_Hidden=True,
    Input_6_Name="Life",
    UnitSystem=4,
    Input_3_GHParam_Branch0_Path="{0}",
    Input_3_GHParam_Branch0_Item0_number=0,
    Input_4_GHParam_Branch0_Path="{0}",
    Input_4_GHParam_Branch0_Item0_number=0,
    Input_5_GHParam_Branch0_Path="{0}",
    Input_5_GHParam_Branch0_Item0_number=0,
    Input_6_GHParam_Branch0_Path="{0}",
    Input_6_GHParam_Branch0_Item0_number=10)  # -> Construction, ConstructionInformation
cost_m2_3 = Panel(".04")
indicators = ApplyIndicators(Object=construction_2.Construction, Life=1, EmbodiedEnergy=0, EmbodiedCarbon=0, Cost=cost_m2)
indicators_2 = ApplyIndicators(Object=construction_3.Construction, Life=1, EmbodiedEnergy=0, EmbodiedCarbon=0, Cost=cost_m2_2)
indicators_3 = ApplyIndicators(Object=construction.Construction, Life=1, EmbodiedEnergy=0, EmbodiedCarbon=0, Cost=cost_m2_3)
cost_m2_4 = Panel(".025")
obj = ClusterOutput(indicators)
obj_2 = ClusterOutput(indicators_3)
panel = Panel(construction_2.ConstructionInformation)
panel_2 = Panel(construction.ConstructionInformation)
obj_3 = ClusterOutput(indicators_2)
panel_3 = Panel(construction_3.ConstructionInformation)
indicators_4 = ApplyIndicators(Object=construction_4.Construction, Life=1, EmbodiedEnergy=0, EmbodiedCarbon=0, Cost=cost_m2_4)
obj_4 = ClusterOutput(indicators_4)
panel_4 = Panel(construction_4.ConstructionInformation)

# ==== cluster Walls

density = Panel("35")
material_name = Panel("XPS Insulation_R7.5")
conductivity = Panel(".034")
specific_heat_capacity = Panel("1400")

density_2 = Panel("35")
material_name_2 = Panel("XPS Insulation_R5Wall")
conductivity_2 = Panel(".034")
specific_heat_capacity_2 = Panel("1400")

density_3 = Panel("35")
material_name_3 = Panel("XPS Insulation_R2.5")
conductivity_3 = Panel(".034")
specific_heat_capacity_3 = Panel("1400")
thickness = Panel(".06")

material = OpaqueMaterial(
    Name=material_name,
    Conductivity=conductivity,
    Density=density,
    Roughness="Rough",
    SpecificHeat=specific_heat_capacity,
    ThermalAbsorptance=0.9,
    SolarAbsorptance=0.7,
    VisibleAbsorptance=0.7,
    Type="Other",
    Input_0_Hidden=False,
    Input_0_Name="Name",
    Input_10_Hidden=True,
    Input_10_Name="TemperatureCoefficientThermalConductivity",
    Input_11_Hidden=True,
    Input_11_Name="TemperatureArray",
    Input_12_Hidden=True,
    Input_12_Name="EnthalpyArray",
    Input_13_Hidden=True,
    Input_13_Name="VariableConductivityArray",
    Input_14_Hidden=False,
    Input_14_Name="Type",
    Input_15_Hidden=True,
    Input_15_Name="EmbodiedEnergy",
    Input_16_Hidden=True,
    Input_16_Name="EmbodiedCarbon",
    Input_17_Hidden=True,
    Input_17_Name="Cost",
    Input_18_Hidden=True,
    Input_18_Name="Life",
    Input_1_Hidden=False,
    Input_1_Name="Conductivity",
    Input_2_Hidden=False,
    Input_2_Name="Density",
    Input_3_Hidden=False,
    Input_3_Name="Roughness",
    Input_4_Hidden=False,
    Input_4_Name="SpecificHeat",
    Input_5_Hidden=False,
    Input_5_Name="ThermalAbsorptance"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)
material_2 = OpaqueMaterial(
    Name=material_name_2,
    Conductivity=conductivity_2,
    Density=density_2,
    Roughness="Rough",
    SpecificHeat=specific_heat_capacity_2,
    ThermalAbsorptance=0.9,
    SolarAbsorptance=0.7,
    VisibleAbsorptance=0.7,
    Type="Other",
    Input_0_Hidden=False,
    Input_0_Name="Name",
    Input_10_Hidden=True,
    Input_10_Name="TemperatureCoefficientThermalConductivity",
    Input_11_Hidden=True,
    Input_11_Name="TemperatureArray",
    Input_12_Hidden=True,
    Input_12_Name="EnthalpyArray",
    Input_13_Hidden=True,
    Input_13_Name="VariableConductivityArray",
    Input_14_Hidden=False,
    Input_14_Name="Type",
    Input_15_Hidden=True,
    Input_15_Name="EmbodiedEnergy",
    Input_16_Hidden=True,
    Input_16_Name="EmbodiedCarbon",
    Input_17_Hidden=True,
    Input_17_Name="Cost",
    Input_18_Hidden=True,
    Input_18_Name="Life",
    Input_1_Hidden=False,
    Input_1_Name="Conductivity",
    Input_2_Hidden=False,
    Input_2_Name="Density",
    Input_3_Hidden=False,
    Input_3_Name="Roughness",
    Input_4_Hidden=False,
    Input_4_Name="SpecificHeat",
    Input_5_Hidden=False,
    Input_5_Name="ThermalAbsorptance"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)
material_3 = GetMaterial(Selection="Plaster")
material_4 = OpaqueMaterial(
    Name=material_name_3,
    Conductivity=conductivity_3,
    Density=density_3,
    Roughness="Rough",
    SpecificHeat=specific_heat_capacity_3,
    ThermalAbsorptance=0.9,
    SolarAbsorptance=0.7,
    VisibleAbsorptance=0.7,
    Type="Other",
    Input_0_Hidden=False,
    Input_0_Name="Name",
    Input_10_Hidden=True,
    Input_10_Name="TemperatureCoefficientThermalConductivity",
    Input_11_Hidden=True,
    Input_11_Name="TemperatureArray",
    Input_12_Hidden=True,
    Input_12_Name="EnthalpyArray",
    Input_13_Hidden=True,
    Input_13_Name="VariableConductivityArray",
    Input_14_Hidden=False,
    Input_14_Name="Type",
    Input_15_Hidden=True,
    Input_15_Name="EmbodiedEnergy",
    Input_16_Hidden=True,
    Input_16_Name="EmbodiedCarbon",
    Input_17_Hidden=True,
    Input_17_Name="Cost",
    Input_18_Hidden=True,
    Input_18_Name="Life",
    Input_1_Hidden=False,
    Input_1_Name="Conductivity",
    Input_2_Hidden=False,
    Input_2_Name="Density",
    Input_3_Hidden=False,
    Input_3_Name="Roughness",
    Input_4_Hidden=False,
    Input_4_Name="SpecificHeat",
    Input_5_Hidden=False,
    Input_5_Name="ThermalAbsorptance"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)
material_5 = GetMaterial(Selection="Concrete Aerated")
# Wall Constructions
material_6 = GetMaterial(Selection="Brick")
M = ClusterOutput(material_3)
M_2 = ClusterOutput(material_5)
thickness_2 = Panel(".1")
thickness_3 = Panel(".013")
mat = ClusterOutput(material)
mat_2 = ClusterOutput(material_2)
mat_3 = ClusterOutput(material_4)
M_3 = ClusterOutput(material_6)
thickness_4 = Panel(".1")
thickness_5 = Panel(".14")
layer = Layer(Material=material_3, Thickness=thickness_3)
layer_2 = Layer(Material=material_5, Thickness=thickness_2)
thickness_6 = Panel(".225")
layer_3 = Layer(Material=material, Thickness=thickness_6)
layer_4 = Layer(Material=material_2, Thickness=thickness_5)
layer_5 = Layer(Material=material_4, Thickness=thickness)
layer_6 = Layer(Material=material_6, Thickness=thickness_4)
construction_name = Panel("Wall R7.5")
construction_name_2 = Panel("Wall R5")
construction_name_3 = Panel("Wall R2.5")
layer_order = Merge(Data1=layer_6, Data2=layer_3, Data3=layer_2, Data4=layer)
layer_order_2 = Merge(Data1=layer_6, Data2=layer_4, Data3=layer_2, Data4=layer)
layer_order_3 = Merge(Data1=layer_6, Data2=layer_5, Data3=layer_2, Data4=layer)
construction = Construction(
    Name=construction_name,
    Category="Facade",
    Layers=flatten(layer_order),
    Input_0_Hidden=False,
    Input_0_Name="Name",
    Input_1_Hidden=False,
    Input_1_Name="Category",
    Input_2_Hidden=False,
    Input_2_Name="Layers",
    Input_3_Hidden=True,
    Input_3_Name="EmbodiedEnergy",
    Input_4_Hidden=True,
    Input_4_Name="EmbodiedCarbon",
    Input_5_Hidden=True,
    Input_5_Name="Cost",
    Input_6_Hidden=True,
    Input_6_Name="Life",
    UnitSystem=4,
    Input_3_GHParam_Branch0_Path="{0}",
    Input_3_GHParam_Branch0_Item0_number=0,
    Input_4_GHParam_Branch0_Path="{0}",
    Input_4_GHParam_Branch0_Item0_number=0,
    Input_5_GHParam_Branch0_Path="{0}",
    Input_5_GHParam_Branch0_Item0_number=0,
    Input_6_GHParam_Branch0_Path="{0}",
    Input_6_GHParam_Branch0_Item0_number=10)  # -> Construction, ConstructionInformation
construction_2 = Construction(
    Name=construction_name_2,
    Category="Facade",
    Layers=flatten(layer_order_2),
    Input_0_Hidden=False,
    Input_0_Name="Name",
    Input_1_Hidden=False,
    Input_1_Name="Category",
    Input_2_Hidden=False,
    Input_2_Name="Layers",
    Input_3_Hidden=True,
    Input_3_Name="EmbodiedEnergy",
    Input_4_Hidden=True,
    Input_4_Name="EmbodiedCarbon",
    Input_5_Hidden=True,
    Input_5_Name="Cost",
    Input_6_Hidden=True,
    Input_6_Name="Life",
    UnitSystem=4,
    Input_3_GHParam_Branch0_Path="{0}",
    Input_3_GHParam_Branch0_Item0_number=0,
    Input_4_GHParam_Branch0_Path="{0}",
    Input_4_GHParam_Branch0_Item0_number=0,
    Input_5_GHParam_Branch0_Path="{0}",
    Input_5_GHParam_Branch0_Item0_number=0,
    Input_6_GHParam_Branch0_Path="{0}",
    Input_6_GHParam_Branch0_Item0_number=10)  # -> Construction, ConstructionInformation
construction_3 = Construction(
    Name=construction_name_3,
    Category="Facade",
    Layers=flatten(layer_order_3),
    Input_0_Hidden=False,
    Input_0_Name="Name",
    Input_1_Hidden=False,
    Input_1_Name="Category",
    Input_2_Hidden=False,
    Input_2_Name="Layers",
    Input_3_Hidden=True,
    Input_3_Name="EmbodiedEnergy",
    Input_4_Hidden=True,
    Input_4_Name="EmbodiedCarbon",
    Input_5_Hidden=True,
    Input_5_Name="Cost",
    Input_6_Hidden=True,
    Input_6_Name="Life",
    UnitSystem=4,
    Input_3_GHParam_Branch0_Path="{0}",
    Input_3_GHParam_Branch0_Item0_number=0,
    Input_4_GHParam_Branch0_Path="{0}",
    Input_4_GHParam_Branch0_Item0_number=0,
    Input_5_GHParam_Branch0_Path="{0}",
    Input_5_GHParam_Branch0_Item0_number=0,
    Input_6_GHParam_Branch0_Path="{0}",
    Input_6_GHParam_Branch0_Item0_number=10)  # -> Construction, ConstructionInformation
cost_m2 = Panel(".035")
cost_m2_2 = Panel(".05")
cost_m2_3 = Panel(".01")
indicators = ApplyIndicators(Object=construction.Construction, Life=1, EmbodiedEnergy=0, EmbodiedCarbon=0, Cost=cost_m2_2)
indicators_2 = ApplyIndicators(Object=construction_2.Construction, Life=1, EmbodiedEnergy=0, EmbodiedCarbon=0, Cost=cost_m2)
indicators_3 = ApplyIndicators(Object=construction_3.Construction, Life=1, EmbodiedEnergy=0, EmbodiedCarbon=0, Cost=cost_m2_3)
obj = ClusterOutput(indicators)
obj_2 = ClusterOutput(indicators_2)
obj_3 = ClusterOutput(indicators_3)
panel = Panel(construction.ConstructionInformation)
panel_2 = Panel(construction_2.ConstructionInformation)
panel_3 = Panel(construction_3.ConstructionInformation)

# ==== cluster Glazing
simple_window = SimpleWindow(Name="Baseline_U2.5_SHGC0.44_Tvis0.65", Shgf="0.44", Uval="2.5", Tvis="0.65")
simple_window_2 = SimpleWindow(Name="LowE_HighSolarGain_U1.3_SHGC0.65_Tvis0.50", Shgf="0.65", Uval="1.3", Tvis="0.50")
cost_m2 = Panel(".1")
simple_window_3 = SimpleWindow(Name="LowE_LowSolarGain_U1.3_SHGC0.22_Tvis0.37", Shgf="0.22", Uval="1.3", Tvis="0.37")
cost_m2_2 = Panel(".2")
cost_m2_3 = Panel(".2")
simple_window_4 = SimpleWindow(Name="SuperLowE_ModerateSolarGain_U0.9_SHGC0.4_Tvis0.55", Shgf="0.4", Uval="0.9", Tvis="0.55")
cost_m2_4 = Panel(".3")
indicators = ApplyIndicators(Object=simple_window, Life=1, EmbodiedEnergy=0, EmbodiedCarbon=0, Cost=cost_m2)
indicators_2 = ApplyIndicators(Object=simple_window_2, Life=1, EmbodiedEnergy=0, EmbodiedCarbon=0, Cost=cost_m2_2)
indicators_3 = ApplyIndicators(Object=simple_window_3, Life=1, EmbodiedEnergy=0, EmbodiedCarbon=0, Cost=cost_m2_3)
indicators_4 = ApplyIndicators(Object=simple_window_4, Life=1, EmbodiedEnergy=0, EmbodiedCarbon=0, Cost=cost_m2_4)
obj = ClusterOutput(indicators)
obj_2 = ClusterOutput(indicators_2)
obj_3 = ClusterOutput(indicators_3)
obj_4 = ClusterOutput(indicators_4)

# ==== cluster Floors

material_name = Panel("XPS_UNDERSLAB")
density = Panel("35")
conductivity = Panel(".03")
specific_heat_capacity = Panel("1400")
thickness = Panel(".4")

density_2 = Panel("2240")
material_name_2 = Panel("Concrete-Dark")
conductivity_2 = Panel("1.95")
specific_heat_capacity_2 = Panel("900")
solar_absorptance = Panel(".9")
material_name_3 = Panel("WoodFloorMat")
conductivity_3 = Panel(".167")
density_3 = Panel("680")
specific_heat_capacity_3 = Panel("1630")
material = OpaqueMaterial(
    Name=material_name,
    Conductivity=conductivity,
    Density=density,
    Roughness="Rough",
    SpecificHeat=specific_heat_capacity,
    ThermalAbsorptance=0.9,
    SolarAbsorptance=0.7,
    VisibleAbsorptance=0.7,
    Type="Other",
    Input_0_Hidden=False,
    Input_0_Name="Name",
    Input_10_Hidden=True,
    Input_10_Name="TemperatureCoefficientThermalConductivity",
    Input_11_Hidden=True,
    Input_11_Name="TemperatureArray",
    Input_12_Hidden=True,
    Input_12_Name="EnthalpyArray",
    Input_13_Hidden=True,
    Input_13_Name="VariableConductivityArray",
    Input_14_Hidden=False,
    Input_14_Name="Type",
    Input_15_Hidden=True,
    Input_15_Name="EmbodiedEnergy",
    Input_16_Hidden=True,
    Input_16_Name="EmbodiedCarbon",
    Input_17_Hidden=True,
    Input_17_Name="Cost",
    Input_18_Hidden=True,
    Input_18_Name="Life",
    Input_1_Hidden=False,
    Input_1_Name="Conductivity",
    Input_2_Hidden=False,
    Input_2_Name="Density",
    Input_3_Hidden=False,
    Input_3_Name="Roughness",
    Input_4_Hidden=False,
    Input_4_Name="SpecificHeat",
    Input_5_Hidden=False,
    Input_5_Name="ThermalAbsorptance"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)
material_2 = OpaqueMaterial(
    Name=material_name_2,
    Conductivity=conductivity_2,
    Density=density_2,
    Roughness="Rough",
    SpecificHeat=specific_heat_capacity_2,
    ThermalAbsorptance=0.9,
    SolarAbsorptance=solar_absorptance,
    VisibleAbsorptance=0.7,
    Type="Other",
    Input_0_Hidden=False,
    Input_0_Name="Name",
    Input_10_Hidden=True,
    Input_10_Name="TemperatureCoefficientThermalConductivity",
    Input_11_Hidden=True,
    Input_11_Name="TemperatureArray",
    Input_12_Hidden=True,
    Input_12_Name="EnthalpyArray",
    Input_13_Hidden=True,
    Input_13_Name="VariableConductivityArray",
    Input_14_Hidden=False,
    Input_14_Name="Type",
    Input_15_Hidden=True,
    Input_15_Name="EmbodiedEnergy",
    Input_16_Hidden=True,
    Input_16_Name="EmbodiedCarbon",
    Input_17_Hidden=True,
    Input_17_Name="Cost",
    Input_18_Hidden=True,
    Input_18_Name="Life",
    Input_1_Hidden=False,
    Input_1_Name="Conductivity",
    Input_2_Hidden=False,
    Input_2_Name="Density",
    Input_3_Hidden=False,
    Input_3_Name="Roughness",
    Input_4_Hidden=False,
    Input_4_Name="SpecificHeat",
    Input_5_Hidden=False,
    Input_5_Name="ThermalAbsorptance"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)
material_3 = OpaqueMaterial(
    Name=material_name_3,
    Conductivity=conductivity_3,
    Density=density_3,
    Roughness="Rough",
    SpecificHeat=specific_heat_capacity_3,
    ThermalAbsorptance=0.9,
    SolarAbsorptance=0.7,
    VisibleAbsorptance=0.7,
    Type="Other",
    Input_0_Hidden=False,
    Input_0_Name="Name",
    Input_10_Hidden=True,
    Input_10_Name="TemperatureCoefficientThermalConductivity",
    Input_11_Hidden=True,
    Input_11_Name="TemperatureArray",
    Input_12_Hidden=True,
    Input_12_Name="EnthalpyArray",
    Input_13_Hidden=True,
    Input_13_Name="VariableConductivityArray",
    Input_14_Hidden=False,
    Input_14_Name="Type",
    Input_15_Hidden=True,
    Input_15_Name="EmbodiedEnergy",
    Input_16_Hidden=True,
    Input_16_Name="EmbodiedCarbon",
    Input_17_Hidden=True,
    Input_17_Name="Cost",
    Input_18_Hidden=True,
    Input_18_Name="Life",
    Input_1_Hidden=False,
    Input_1_Name="Conductivity",
    Input_2_Hidden=False,
    Input_2_Name="Density",
    Input_3_Hidden=False,
    Input_3_Name="Roughness",
    Input_4_Hidden=False,
    Input_4_Name="SpecificHeat",
    Input_5_Hidden=False,
    Input_5_Name="ThermalAbsorptance"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)
mat = ClusterOutput(material)
mat_2 = ClusterOutput(material_2)
thickness_2 = Panel(".15")
thickness_3 = Panel(".02")
layer = Layer(Material=material, Thickness=thickness)
layer_2 = Layer(Material=material_2, Thickness=thickness_2)
mat_3 = ClusterOutput(material_3)
layer_3 = Layer(Material=material_3, Thickness=thickness_3)
merge = Merge(Data1=layer, Data2=layer_2)
merge_2 = Merge(Data1=layer, Data2=layer_3)
construction = Construction(
    Name="ConcreteFloor",
    Category="GroundFloor",
    Layers=flatten(layer_2),
    Input_0_Hidden=False,
    Input_0_Name="Name",
    Input_1_Hidden=False,
    Input_1_Name="Category",
    Input_2_Hidden=False,
    Input_2_Name="Layers",
    Input_3_Hidden=True,
    Input_3_Name="EmbodiedEnergy",
    Input_4_Hidden=True,
    Input_4_Name="EmbodiedCarbon",
    Input_5_Hidden=True,
    Input_5_Name="Cost",
    Input_6_Hidden=True,
    Input_6_Name="Life",
    UnitSystem=4,
    Input_3_GHParam_Branch0_Path="{0}",
    Input_3_GHParam_Branch0_Item0_number=0,
    Input_4_GHParam_Branch0_Path="{0}",
    Input_4_GHParam_Branch0_Item0_number=0,
    Input_5_GHParam_Branch0_Path="{0}",
    Input_5_GHParam_Branch0_Item0_number=0,
    Input_6_GHParam_Branch0_Path="{0}",
    Input_6_GHParam_Branch0_Item0_number=10)  # -> Construction, ConstructionInformation
construction_2 = Construction(
    Name="ConcreteOnGrade",
    Category="GroundFloor",
    Layers=flatten(merge),
    Input_0_Hidden=False,
    Input_0_Name="Name",
    Input_1_Hidden=False,
    Input_1_Name="Category",
    Input_2_Hidden=False,
    Input_2_Name="Layers",
    Input_3_Hidden=True,
    Input_3_Name="EmbodiedEnergy",
    Input_4_Hidden=True,
    Input_4_Name="EmbodiedCarbon",
    Input_5_Hidden=True,
    Input_5_Name="Cost",
    Input_6_Hidden=True,
    Input_6_Name="Life",
    UnitSystem=4,
    Input_3_GHParam_Branch0_Path="{0}",
    Input_3_GHParam_Branch0_Item0_number=0,
    Input_4_GHParam_Branch0_Path="{0}",
    Input_4_GHParam_Branch0_Item0_number=0,
    Input_5_GHParam_Branch0_Path="{0}",
    Input_5_GHParam_Branch0_Item0_number=0,
    Input_6_GHParam_Branch0_Path="{0}",
    Input_6_GHParam_Branch0_Item0_number=10)  # -> Construction, ConstructionInformation
construction_3 = Construction(
    Name="WoodOnGrade",
    Category="GroundFloor",
    Layers=flatten(merge_2),
    Input_0_Hidden=False,
    Input_0_Name="Name",
    Input_1_Hidden=False,
    Input_1_Name="Category",
    Input_2_Hidden=False,
    Input_2_Name="Layers",
    Input_3_Hidden=True,
    Input_3_Name="EmbodiedEnergy",
    Input_4_Hidden=True,
    Input_4_Name="EmbodiedCarbon",
    Input_5_Hidden=True,
    Input_5_Name="Cost",
    Input_6_Hidden=True,
    Input_6_Name="Life",
    UnitSystem=4,
    Input_3_GHParam_Branch0_Path="{0}",
    Input_3_GHParam_Branch0_Item0_number=0,
    Input_4_GHParam_Branch0_Path="{0}",
    Input_4_GHParam_Branch0_Item0_number=0,
    Input_5_GHParam_Branch0_Path="{0}",
    Input_5_GHParam_Branch0_Item0_number=0,
    Input_6_GHParam_Branch0_Path="{0}",
    Input_6_GHParam_Branch0_Item0_number=10)  # -> Construction, ConstructionInformation
construction_4 = Construction(
    Name="WoodFloor",
    Category="GroundFloor",
    Layers=flatten(layer_3),
    Input_0_Hidden=False,
    Input_0_Name="Name",
    Input_1_Hidden=False,
    Input_1_Name="Category",
    Input_2_Hidden=False,
    Input_2_Name="Layers",
    Input_3_Hidden=True,
    Input_3_Name="EmbodiedEnergy",
    Input_4_Hidden=True,
    Input_4_Name="EmbodiedCarbon",
    Input_5_Hidden=True,
    Input_5_Name="Cost",
    Input_6_Hidden=True,
    Input_6_Name="Life",
    UnitSystem=4,
    Input_3_GHParam_Branch0_Path="{0}",
    Input_3_GHParam_Branch0_Item0_number=0,
    Input_4_GHParam_Branch0_Path="{0}",
    Input_4_GHParam_Branch0_Item0_number=0,
    Input_5_GHParam_Branch0_Path="{0}",
    Input_5_GHParam_Branch0_Item0_number=0,
    Input_6_GHParam_Branch0_Path="{0}",
    Input_6_GHParam_Branch0_Item0_number=10)  # -> Construction, ConstructionInformation
cost_m2 = Panel(".01")
cost_m2_2 = Panel(".01")
indicators = ApplyIndicators(Object=construction_2.Construction, Life=1, EmbodiedEnergy=0, EmbodiedCarbon=0, Cost=cost_m2)
obj = ClusterOutput(indicators)
con = ClusterOutput(construction_3.Construction)
con_2 = ClusterOutput(construction_4.Construction)
indicators_2 = ApplyIndicators(Object=construction.Construction, Life=1, EmbodiedEnergy=0, EmbodiedCarbon=0, Cost=cost_m2_2)
obj_2 = ClusterOutput(indicators_2)

# ==== cluster FloorArea
model = ClusterInput()
exmod = ExplodeModel(
    Model=model,
    Output_0_Hidden=False,
    Output_0_Name="Facade",
    Output_10_Hidden=False,
    Output_10_Name="WallGround",
    Output_11_Hidden=True,
    Output_11_Name="Area",
    Output_12_Hidden=True,
    Output_12_Name="Zone Settings",
    Output_13_Hidden=True,
    Output_13_Name="Window Settings",
    Output_1_Hidden=True,
    Output_1_Name="Partition",
    Output_2_Hidden=True,
    Output_2_Name="Ceiling",
    Output_3_Hidden=True,
    Output_3_Name="Roof",
    Output_4_Hidden=False,
    Output_4_Name="ExternalFloor",
    Output_5_Hidden=False,
    Output_5_Name="Floor",
    Output_6_Hidden=False,
    Output_6_Name="Window",
    Output_7_Hidden=True,
    Output_7_Name="Face ID",
    Output_8_Hidden=True,
    Output_8_Name="ID Location",
    Output_9_Hidden=False,
    Output_9_Name="FloorGround")  # -> Facade, ExternalFloor, Floor, Window, FloorGround, WallGround
area = Area(Geometry=flatten([exmod.ExternalFloor, exmod.Floor, exmod.FloorGround]))  # -> Area, Centroid
ma = MassAddition(Input=flatten(area.Area))  # -> Result, PartialResults
python = GhPythonScript(x=ma.Result)  # -> out, a
# ---------- python: Python ----------
__author__ = "ajakubiec"
__version__ = "2020.11.10"

import rhinoscriptsyntax as rs

a = '%.0f m2' % x
# ---------- end python ----------
a = ClusterOutput(python.a)

# ==== cluster ConstructionCost
model = ClusterInput()
dimming = ClusterInput()
lpd = ClusterInput()
hvac = ClusterInput()
shade = ClusterInput()
fans = ClusterInput()
hrv = ClusterInput()
ach = ClusterInput()
integrate_indicators = IntegrateIndicators(Model=model, LifeTime="1", type="Construction")  # -> flatten(Label), EmbodiedEnergy, Carbon, flatten(Cost)
python = GhPythonScript(dimming=dimming, lpd=lpd, hvac=hvac, shade=shade, fans=fans, hrv=hrv, ach=ach)  # -> out, a; inputs shade: list
# ---------- python: Python ----------
__author__ = "ajakubiec"
__version__ = "2020.11.10"

import rhinoscriptsyntax as rs

area_shade = 0.0

for s in shade:
    area_shade += rs.SurfaceArea(s)[0]

a = 0.0 # cost

a += area_shade * 0.15

print("Shade cost: %.2f" % (area_shade * 0.15))

if lpd == 6:
    a += 6
    print("LED lighting cost: $6.00")

if dimming == "Continuous":
    a += 5
    print("Daylight dimming cost: $5.00")

if hvac == "0.90,3.1":
    a += 6
    print("Gas-fired Boiler Heating, Direct Expansion Cooling cost: $6.00")

if hvac == "3.1,3.93":
    a += 12
    print("Ground Source Heat Pump Heating and Cooling cost: $12.00")

if fans == "On":
    a += 5
    print("Ceiling fans cost: $5.00")

if hrv == "On":
    a += 3
    print("HRV cost: $3.00")

if ach < 0.3:
    a += 6
    print("Airtight construction cost: $6.00")
# ---------- end python ----------
division = Division(A=integrate_indicators.Cost, B="5")
ma = MassAddition(Input=[division, python.a])  # -> Result, PartialResults
panel = Panel(python.out)
python_2 = GhPythonScript(x=ma.Result)  # -> out, a
# ---------- python_2: Python ----------
__author__ = "ajakubiec"
__version__ = "2020.11.10"

import rhinoscriptsyntax as rs

a = '%.0f' % x
# ---------- end python_2 ----------
panel_2 = Panel(division)
a = ClusterOutput(python_2.a)
panel_3 = Panel(integrate_indicators.Label)

# ==== cluster Cluster_5
G = ClusterInput()
num = ClusterInput()
volume = Volume(Geometry=G)  # -> Volume, Centroid
num_2 = Number(num)
scene = ClusterInput()
pdecon = Deconstruct(Point=volume.Centroid)  # -> XComponent, YComponent, ZComponent
multiplication = Multiplication(A="1", B=num_2)
multiplication_2 = Multiplication(A="60", B=num_2)
pt = ConstructPoint(XCoordinate=pdecon.XComponent, YCoordinate=pdecon.YComponent, ZCoordinate=multiplication)
shading_mask = ShadingMask(Pt=pt, Dir=Vector(0, 1, 0), Radius=multiplication_2, HAng="1", VAng=5, Scene=scene, Full=True, Mode=2)
mask = ClusterOutput(shading_mask)
