# Grasshopper definition context-and-boundary-exporter.gh (Grasshopper 1.0.7)
# plug-ins: Pancake

pipeline = GeometryPipeline(
    GroupByLayer=False,
    GroupByType=False,
    IncludeHidden=True,
    IncludeLocked=True,
    LayerFilter="UrbanContext",
    NameFilter="*",
    SublayerFiltering=True,
    TypeFilter=1073741848)
pipeline_2 = GeometryPipeline(
    GroupByLayer=False,
    GroupByType=False,
    IncludeHidden=True,
    IncludeLocked=True,
    LayerFilter="SiteBoundary",
    NameFilter="*",
    SublayerFiltering=True,
    TypeFilter=36)
number_slider = Slider(10, range=0..10)
geo = Geometry(pipeline_2)
explode = Explode(Curve=geo, Recursive=True)  # -> Segments, Vertices
geo_2 = Geometry(pipeline)
end = EndPoints(Curve=explode.Segments)  # -> Start, End
debox = DeconstructBox(Box=geo_2)  # -> Plane, X, Y, Z
python = GhPythonScript(points=end.Start)  # -> out, output; inputs points: list of Point3d
# ---------- python: Python ----------
__author__ = "szvsw"
__version__ = "2022.01.05"

import rhinoscriptsyntax as rs
import json
data = []
for pt in points:
    data.append([pt[0],pt[1],pt[2]])
    
    
output = json.dumps(data)
# ---------- end python ----------
dedomain = DeconstructDomain(Domain=debox.X)  # -> Start, End
dedomain_2 = DeconstructDomain(Domain=debox.Z)  # -> Start, End
dedomain_3 = DeconstructDomain(Domain=debox.Y)  # -> Start, End
subtraction = Subtraction(A=dedomain.End, B=dedomain.Start)
subtraction_2 = Subtraction(A=dedomain_3.End, B=dedomain_3.Start)
subtraction_3 = Subtraction(A=dedomain_2.End, B=dedomain_2.Start)
python_2 = GhPythonScript(
    x=dedomain.Start,
    y=dedomain_3.Start,
    z=dedomain_2.Start,
    u=subtraction,
    v=subtraction_2,
    w=subtraction_3,
    boundary=python.output)  # -> out, output; inputs x: list, y: list, z: list, u: list, v: list, w: list
# ---------- python_2: Python ----------
__author__ = "szvsw"
__version__ = "2022.01.05"

import rhinoscriptsyntax as rs
import json
data = {'context':[], 'boundary':json.loads(boundary)}
for i in range(len(x)):
    position = [x[i],y[i],z[i]]
    dimensions = [u[i],v[i],w[i]]
    building = {'type':"box",'position':position,'rotation':[0,0,0],'size':dimensions}
    data['context'].append(building)


output = json.dumps(data)
# ---------- end python_2 ----------
path = FilePath("C:\Users\Sam Wolk\Dropbox\mit\sim-game-react\sim-game-react\public\model.json")
pcexporttxt = ExportTXT(
    Content=python_2.output,
    FileLocation=path,
    Overwrite=invert(False),
    Encoding="utf-8",
    Export=Button(),
    LastSaveLocalization="neutral,N")
